# Grasshopper definition Gh_src_D1_20171215.gh (Grasshopper 0.9.76)
# plug-ins: LunchBox

# ----
# Inputs
fadeing_distance = Slider(167.77, range=0..715)
blank_distance = Slider(0.176, range=0..22)
max_scale = Slider(0.795, range=0..1)
number_slider = Slider(97, range=0..100)
number_slider_2 = Slider(95, range=0..100)
main_scale = Slider(0.981, range=0.001..3)
min_value = Slider(0.016, range=0..1)
fade_to_edge = BooleanToggle(False)
display_color = ColourSwatch(SwatchColor=RGB(255, 255, 255))
base_surface = Surface(reparameterize(<surface referenced from the Rhino model>))
list = ValueList({"Simple": 0, "advanced": 1}, selected="advanced")
shape_curve = Curve(<curve referenced from the Rhino model>)

controll_curve = Curve(<curve referenced from the Rhino model>)

# ----
# Hexagon grid
v_count = Number(number_slider_2)
u_count = Number(number_slider)
base_surface_2 = Surface(base_surface)
hex = HexagonCells(Surface=base_surface_2, UDivisions=u_count, VDivisions=v_count, TParameter=0.25)  # -> HexagonCells, Centers
point_on_srf = Point(hex.Centers)

# ----
# Rectangle grid
v_count_2 = Number(number_slider_2)
base_surface_3 = Surface(base_surface)
u_count_2 = Number(number_slider)
range = Range(Domain=Domain(0, 1), Steps=v_count_2)
range_2 = Range(Domain=Domain(0, 1), Steps=u_count_2)
crossref = CrossReference(ListA=range_2, ListB=range, CrossMode=1)  # -> ListA, ListB
pt = ConstructPoint(XCoordinate=crossref.ListA, YCoordinate=crossref.ListB, ZCoordinate=0)
evalsrf = EvaluateSurface(Surface=base_surface_3, Point=pt)  # -> Point, Normal, Frame
point_on_srf_2 = Point(evalsrf.Point)
frame_on_srf = Plane(evalsrf.Frame)

# ----
# Point to Frame
base_surface_4 = Surface(base_surface)
point_on_srf_3 = Point(point_on_srf)
srf_cp = SurfaceClosestPoint(Point=point_on_srf_3, Surface=base_surface_4)  # -> Point, UVPoint, Distance
evalsrf_2 = EvaluateSurface(Surface=base_surface_4, Point=srf_cp.UVPoint)  # -> Point, Normal, Frame
frame_on_srf_2 = Plane(evalsrf_2.Frame)

# ----
# Switch
frame_on_srf_3 = Plane(evalsrf_2.Frame)
switch = Number(list)
switch_2 = Switch(selector="1", gate=switch, data=frame_on_srf_3)
frame = Plane(switch_2)

# ----
# Distance to curve & edge
control_curve_curve = Curve(controll_curve)
frame_on_srf_4 = Plane(simplify(frame))
base_surface_5 = Surface(base_surface)
fade_to_edge_2 = Boolean(fade_to_edge)
filter = StreamFilter(Gate=fade_to_edge_2, Stream1=base_surface_5)
edges = BrepEdges(Brep=filter)  # -> Naked, Interior, NonManifold
join = JoinCurves(Curves=edges.Naked, Preserve=False)  # -> simplify(Curves)
entwine = Entwine(Branch00=join, Branch01=control_curve_curve, FlattenInputs=True)
fading_curves = Curve(graft(entwine))
crv_cp = CurveClosestPoint(Point=frame_on_srf_4, Curve=fading_curves)  # -> Point, Parameter, Distance
distance = Number(crv_cp.Distance)

# ----
# Find lowest distance
distances = Number(distance)  # disabled
flip = FlipMatrix(Data=distances)  # disabled
sort = SortList(Keys=flip)  # -> Keys, ValuesA; disabled
lng = ListLength(List=sort.Keys)  # disabled
item = ListItem(List=sort.Keys, Index=expr("x-1", lng), Wrap=True)  # disabled
item_2 = ListItem(List=sort.Keys, Index=0, Wrap=True)  # disabled
max = Number(item)  # disabled
min = Number(item_2)  # disabled

distances_2 = Number(distance)

# ----
# Find lowest distance
distances_3 = Number(distance)  # disabled
bang = ExplodeTree(Data=distances_3)  # -> Branch0, Branch1; disabled
min_2 = Minimum(A=bang.Branch0, B=bang.Branch1)  # disabled
distance_2 = Number(min_2)  # disabled

# ----
# Find lowest distance
flip_2 = FlipMatrix(Data=distances_2)
bnd = Bounds(Numbers=flip_2)
dedomain = DeconstructDomain(Domain=bnd)  # -> Start, End
max_2 = Number(dedomain.End)
min_3 = Number(dedomain.Start)

# ----
# Tag rounded
frame_on_srf_5 = Plane(frame)
distance_3 = Number(min_3)
round = Round(Number=distance_3)  # -> Nearest, Floor, Ceiling
tag = TextTag3D(Location=frame_on_srf_5, Text=round.Nearest, Size=1)  # disabled

blank_distance_2 = Number(blank_distance)

# ----
# Remap distance
# Old version needs min/max
distance_4 = Number(flatten(min_3))
fadeing_distance_2 = Number(fadeing_distance)
max_radius = Number(max_scale)
dom = ConstructDomain(DomainStart=blank_distance_2, DomainEnd=fadeing_distance_2)
dom_2 = ConstructDomain(DomainStart=0, DomainEnd=max_radius)
remap = RemapNumbers(Value=distance_4, Source=dom, Target=dom_2)
min_4 = Minimum(A=max_radius, B=remap)
max_3 = Maximum(A=min_4, B=0)
scale = Number(max_3)

min_scale = Number(min_value)

# ----
# Remove too small
scale_2 = Number(scale)
expression = Expression(x=scale_2, y=min_scale, u="0", v=scale_2, Expression="if(x<y,u,v)")

# ----
# Scale Curve
# ignore errors
controled_scale = Number(expression)
shape_curve_2 = Curve(shape_curve)
main_scale_2 = Number(main_scale)
area = Area(Geometry=shape_curve_2)  # -> Area, Centroid
multiplication = Multiplication(A=controled_scale, B=main_scale_2)
scale_3 = Scale(Geometry=shape_curve_2, Center=area.Centroid, Factor=multiplication)  # -> Geometry, Transform

# ----
# Circles
frame_on_srf_6 = Plane(frame_on_srf_4)
radius = Number(expression)
cir = Circle(Plane=frame_on_srf_6, Radius=radius)

# ----
# Map Curve
source_point = Point(area.Centroid)
target_point = Point(frame)
shape_curve_3 = Curve(scale_3.Geometry)
vec2pt = Vector2Pt(PointA=source_point, PointB=target_point, Unitize=False)  # -> Vector, Length
move = Move(Geometry=shape_curve_3, Motion=vec2pt.Vector)  # -> Geometry, Transform

# ----
# Preview
color = Colour(display_color)
preview = CustomPreview(Geometry=move.Geometry, Shader=color)

# ==== cluster Switch
selector = ClusterInput()
gate = ClusterInput()
if_x_in_y = PythonScript(x=selector, y=gate)  # -> out, a
# ---------- if_x_in_y: Python ----------
try:
    x = str(x)
except:
    pass
try:
    y = str(y)
except:
    pass
if x in y:
    a = True
else:
    a = False
# ---------- end if_x_in_y ----------
data = ClusterInput()
filter = StreamFilter(Gate=if_x_in_y.a, Stream1=data)
data_2 = ClusterOutput(filter)
